vi "index.gviweb"   [G Web Development Software 22.3.0]
panel controls:
  "Usuario": string
  "Contraseña": string
  "Confirm Button": bool
  "Logo3G_Image": string = "Image/LOGO%202024%20V3%20205X50.png"
  "LogoEecol_Image": string = "Image/EECOL%20LOGO%20156X50.png"
  "LogoLF_Image": string = "Image/LITELLFUSE%20201X50.png"
  "LogoPHOC_Image": string = "Image/PHOENIX%20CONTACT%20LOGO%20196X50.png"
  "Logo3G_Image_2": string = "Image/LOGO%202024%20V3%20205X50.png"
  "LogoEecol_Image_2": string = "Image/EECOL%20LOGO%20156X50.png"
  "LogoLF_Image_2": string = "Image/LITELLFUSE%20201X50.png"
  "LogoPHOC_Image_2": string = "Image/PHOENIX%20CONTACT%20LOGO%20196X50.png"
  "Logo3G_Image_3": string = "Image/LOGO%202024%20V3%20205X50.png"
  "LogoEecol_Image_3": string = "Image/EECOL%20LOGO%20156X50.png"
  "LogoLF_Image_3": string = "Image/LITELLFUSE%20201X50.png"
  "LogoPHOC_Image_3": string = "Image/PHOENIX%20CONTACT%20LOGO%20196X50.png"
  "Panel_Image_2": string = "Image/CDC%20ABB%2001%20450X290.png"
  "LogoEecol_Image_4": string = "Image/EECOL%20LOGO%20156X50.png"
panel indicators:
  "body": string
  "Tab": i32
  "Light on Sensor 1 Max": cluster{"Element 1": f64, "Element 2": f64}
  "SENSOR 1": bool
  "SENSOR 3": bool
  "TRIP 1": bool
  "TRIP 2": bool
  "PROTECTION ACTIVE": bool
  "TRIPPED": bool
  "Light on Sensor 3 Max": cluster{"Element 1": f64, "Element 2": f64}
  "S1 LoS Max": f64
  "S3 LoS Max": f64
  "S1 Lux Max": f64
  "S3 Lux Max": f64
  "URL Image": string
  "URL Image_2": string
  "URL Image_4": string
  "SENSOR 1_2": bool
  "SENSOR 3_2": bool
  "TRIP 1_2": bool
  "TRIP 2_2": bool
  "PROTECTION ACTIVE_2": bool
  "TRIPPED_2": bool
  "S1 LoS Max_2": f64
  "S3 LoS Max_2": f64
  "Light on Sensor 1 Max_2": cluster{"Element 1": f64, "Element 2": f64}
  "Light on Sensor 3 Max_2": cluster{"Element 1": f64, "Element 2": f64}
  "body_2": string
  "CDC_ABB": string
  "URL Image_3": string
  "URL Image_5": string
types:
  T1 = cluster{"S1max": f64, "S1": bool, "S3max": f64, "S3": bool, "PActive": bool, "Tripped": bool, "Trip1": bool, "Trip2": bool}
uses:
  NI::HTTP::Open HTTP Handle.gvi
  NI::HTTP::GET.gvi
  NI::HTTP::PUT Buffer.gvi
  NI::HTTP::Close HTTP Handle.gvi
diagram:
  disable {
    frame Enabled { }
    frame Disabled { }
  }
  sequence {
    frame 0 {
      Property Node(instance in=reference to "Usuario", "Value"="")
      Property Node(instance in=reference to "Contraseña", "Value"="")
      Property Node(instance in=reference to unnamed text, "Visible"=FALSE)
      $Tab <- 0
    }
  }
  call "Open HTTP Handle.gvi"(error in=no error) -> (client handle out=w1, error out=w2)
  s1 = w2  # shift register
  s2 = w1  # shift register
  while {
    Wait(time to wait=250)
    w3 = cluster{"user": string, "password": string} {all zero or empty}
    w4 = "https://arc-flash-relay-default-rtdb.firebaseio.com/access.json"
    call "GET.gvi"(client handle=s2, url=w4, error in=s1) -> (client handle out=w5, body=w6, error out=w7)
    Unflatten From Json(JSON string=w6, type and defaults=w3) -> (value=w8)
    case ($"Confirm Button") {
      frame False, Default {
        w9 = FALSE
      }
      frame True {
        Property Node(instance in=w8) -> ("user"=w10, "password"=w11)
        Is Equal(x=$Usuario, y=w10) -> w12
        Is Equal(x=w11, y=$Contraseña) -> w13
        Logical And(w12, w13) -> w9
        case (w9) {
          frame True {
            Property Node(instance in=reference to unnamed text, "Visible"=FALSE)
          }
          frame False {
            Property Node(instance in=reference to unnamed text, "Visible"=TRUE)
          }
        }
      }
    }
    next s1 = w7
    next s2 = w5
    stop if w9
  }
  # Top-Level WebVIs usually contain a While Loop that never stops so that they can continue running as long as the web page is open in the user's web browser.
  s3 = s2  # shift register
  s4 = s1  # shift register
  while {
    Wait(time to wait=50)
    $Tab <- 1
    disable {
      frame Enabled {
        w14 = s4
        w15 = s3
      }
      frame Disabled {
        w16 = "https://arc-flash-relay-default-rtdb.firebaseio.com/data-read.json"
        Property Node(instance in=cluster{"Reset": bool} {all zero or empty}) -> (instance out=w17)
        Flatten To Json(anything=w17) -> (JSON string=w18)
        call "PUT Buffer.gvi"(client handle=s3, url=w16, buffer=w18, error in=s4) -> (client handle out=w15, error out=w14)
      }
    }
    w19 = "https://arc-flash-relay-default-rtdb.firebaseio.com/data-send.json"
    call "GET.gvi"(client handle=w15, url=w19, error in=w14) -> (client handle out=w20, body=w21, error out=w22)
    $body <- w21
    Unflatten From Json(JSON string=w21, type and defaults=T1 {all zero or empty}) -> (value=w23)
    Property Node(instance in=w23) -> ("S1max"=w24, "S1"=w25, "S3max"=w26, "S3"=w27, "PActive"=w28, "Tripped"=w29, "Trip1"=w30, "Trip2"=w31)
    $"SENSOR 1" <- w25
    $"SENSOR 3" <- w27
    $"PROTECTION ACTIVE" <- w28
    $TRIPPED <- w29
    $"S1 Lux Max" <- w24
    $"S1 LoS Max" <- w24
    $"S3 Lux Max" <- w26
    $"S3 LoS Max" <- w26
    $"TRIP 1" <- w30
    $"TRIP 2" <- w31
    Build Cluster(w24, 13000) -> w32
    $"Light on Sensor 1 Max" <- w32
    Build Cluster(w26, 13000) -> w33
    $"Light on Sensor 3 Max" <- w33
    next s3 = w20
    next s4 = w22
    stop if FALSE
  }
  call "Close HTTP Handle.gvi"(client handle=s3, error in=s4)
